# Dynamo custom node Arc.ByLine.dyf (Dynamo 0.9.0.3067)
# category: Landform.Geometry.Arc
# Create an arc from the start and end point of a line. Specify the height of the arc (from 0 to 1) and (if desired) flip the arc across the line.

flip = Input(flip : bool = true)
curve = Input()
startPoint = Curve.StartPoint(curve)
midPoint = Custom[Curve.MidPoint](curve=curve)  # Get the midpoint along the Curve
endPoint = Curve.EndPoint(curve)
byCenterPointStartPointEndPoint = Arc.ByCenterPointStartPointEndPoint(midPoint, startPoint, endPoint)
midPoint_2 = Custom[Curve.MidPoint](curve=byCenterPointStartPointEndPoint)
byStartPointEndPoint = Line.ByStartPointEndPoint(startPoint=midPoint, endPoint=midPoint_2)
length = Curve.Length(byStartPointEndPoint)
height = Input()
code_block = CodeBlock(length=length, x=height) { length*x; }
pointAtDistance = Curve.PointAtDistance(byStartPointEndPoint, code_block)
byTwoPoints = Vector.ByTwoPoints(start=pointAtDistance, end=midPoint)
add = Vector.Add(byTwoPoints, byTwoPoints)
add_2 = Point.Add(point=pointAtDistance, vectorToAdd=add)
byThreePoints = Arc.ByThreePoints(firstPoint=startPoint, secondPoint=add_2, thirdPoint=endPoint)
byThreePoints_2 = Arc.ByThreePoints(firstPoint=startPoint, secondPoint=pointAtDistance, thirdPoint=endPoint)
if_ = If(test=flip, true=byThreePoints, false=byThreePoints_2)
Curve = Output(if_)
