# Dynamo custom node Curve.DivideByLengthRemainders.dyf (Dynamo 1.1.0.2094)
# category: Landform.Geometry.Curve
# Divides curve into curves of given length. Will return remainder at end or split the remainder between the start and end.

curve = Input()
code_block = CodeBlock(data=curve) { data; }
startPoint = Curve.StartPoint(code_block)
length = Input(length : double)
code_block_2 = CodeBlock(data=length) { data; }
pointsAtSegmentLengthFromPoint = Curve.PointsAtSegmentLengthFromPoint(code_block, startPoint, code_block_2)
splitByPoints = Curve.SplitByPoints(curve=code_block, points=pointsAtSegmentLengthFromPoint)
code_block_3 = CodeBlock(data=splitByPoints) { data; }
RemainderEnd = Output(code_block_3)
lastItem = List.LastItem(splitByPoints, lacing=CrossProduct)
length_2 = Curve.Length(lastItem)
code_block_4 = CodeBlock(l=code_block_2) { l/2; }
gt = length_2 > code_block_4
code_block_5 = CodeBlock(r=length_2, l=code_block_2) { r+l; }
if_ = If(test=gt, true=length_2, false=code_block_5)
code_block_6 = CodeBlock(r2=if_) { r2/2; }
pointAtSegmentLength = Curve.PointAtSegmentLength(curve=code_block, segmentLength=code_block_6)
pointsAtSegmentLengthFromPoint_2 = Curve.PointsAtSegmentLengthFromPoint(code_block, pointAtSegmentLength, code_block_2)
splitByPoints_2 = Curve.SplitByPoints(curve=code_block, points=pointsAtSegmentLengthFromPoint_2)
code_block_7 = CodeBlock(data=splitByPoints_2) { data; }
RemainderSplit = Output(code_block_7)
