# Dynamo custom node Curve.DivideEqually.dyf (Dynamo 1.1.0.2094)
# category: Landform.Geometry.Curve
# Divides a curve into a given number of equal length curves.

curve = Input()
divisions = Input(divisions : int)
pointsAtEqualSegmentLength = Curve.PointsAtEqualSegmentLength(curve=curve, divisions=divisions)
splitByPoints = Curve.SplitByPoints(curve=curve, points=pointsAtEqualSegmentLength)
Curve = Output(splitByPoints)  # "Curve[]"
