# Dynamo custom node Curve.DividePoints.dyf (Dynamo 1.1.0.2094)
# category: Landform.Geometry.Curve
# Get the (start) points along an equally divided curve.

curve = Input()
divisions = Input()
divideEqually = Custom[Curve.DivideEqually](curve=curve, divisions=divisions)  # Divides a curve into a given number of equal length curves.
startPoint = Curve.StartPoint(divideEqually)
code_block = CodeBlock(lst=startPoint) { Flatten(lst<1>); }
Points = Output(code_block)
