# Dynamo custom node Curve.MidPoint.dyf (Dynamo 0.9.0.3067)
# category: Landform.Geometry.Curve
# Get the midpoint along the Curve

curve = Input()
length = Curve.Length(curve)
code_block = CodeBlock(x=length) { x/2; }
pointAtDistance = Curve.PointAtDistance(curve, code_block)
Point = Output(pointAtDistance)
