# Dynamo custom node Curve.StartMidPoint.dyf (Dynamo 0.9.0.3067)
# category: Landform.Geometry.Curve
# Get the start point and midpoint along the Curve.

create = List.Create()
curve = Input()
startPoint = Curve.StartPoint(curve)
midPoint = Custom[Curve.MidPoint](curve=curve)  # Get the midpoint along the Curve
combine = List.Combine(create, startPoint, midPoint)
code_block = CodeBlock(lst=combine) { List.Transpose(lst<1>); }
code_block_2 = CodeBlock(lst=code_block) { Flatten(lst<1>); }
Points = Output(code_block_2)
