# Dynamo custom node Element.TopBasePolysurface.dyf (Dynamo 0.9.2.4472)
# category: Landform.Revit.Elements
# Get the top and bottom polysurfaces from an element.

element = Input()
geometry = Element.Geometry(element)
faces = Element.Faces(geometry)
surfaceGeometry = Face.SurfaceGeometry(faces)
topBasePolysurface = Custom[Surfaces.TopBasePolysurface](surfaces=surfaceGeometry)  # Get the top and bottom polysurfaces from a set of surfaces.
PolySurfaceTop = Output(topBasePolysurface.PolySurfaceTop)
PolySurfaceBase = Output(topBasePolysurface.PolySurfaceBase)
