# Dynamo custom node Elements.RandomizeParameter.dyf (Dynamo 0.9.0.3067)
# category: Landform.Revit.Elements.Parameter
# Set an element's instance parameter to a random value between a range specified by the minimum and maximum parameter.

elements = Input()

# group: Element.Type
code_block = CodeBlock(item=elements) { Flatten({item}); }
python_script = Python(IN[0]=code_block)
# ---------- python_script.python (12 lines) ----------
import clr
clr.AddReference('RevitAPI')
from Autodesk.Revit.DB import *

items = UnwrapElement(IN[0])
typelist = list()
for item in items:
	try: 
		typelist.append(item.Document.GetElement(item.GetTypeId()))
	except:
		typelist.append(list())
OUT = typelist
# ----------------------------------------
python_script_2 = Python(IN[0]=elements, IN[1]=python_script)
# ---------- python_script_2.python (4 lines) ----------
check = IN[0]
items = IN[1]
if isinstance(check, (list)): OUT = items
else: OUT = items[0]
# ----------------------------------------

groupByKey = GroupByKey(elements, python_script_2)
instance = Input(instance : string)
min = Input(min : string)
getParameterValueByName = Element.GetParameterValueByName(element=groupByKey.out1, parameterName=min)
max = Input(max : string)
getParameterValueByName_2 = Element.GetParameterValueByName(element=groupByKey.out1, parameterName=max)
count = Count()
map = List.Map(list=groupByKey.out0, f_x=count)
randomIntegerMin = Custom[Math.RandomIntegerMin](min=getParameterValueByName, max=getParameterValueByName_2, amount=map)  # Creates a list of random integers between a given minimum and maximum value
setParameterByName = Element.SetParameterByName(element=groupByKey.out0, parameterName=instance, value=randomIntegerMin)
Element = Output(setParameterByName)
