# Dynamo custom node FamilyInstance.Percentage.dyf (Dynamo 0.9.0.3067)
# category: Landform.Revit.Elements.FamilyInstance
# Place familiy instances by point from a list of multiple family types and percentages.

byPoint = FamilyInstance.ByPoint()
cycle = List.Cycle()
familyTypes = Input()
code_block = CodeBlock { 1; }
chop = List.Chop(familyTypes, code_block)
points = Input()
percent = Input()
code_block_2 = CodeBlock(ct=points, lst=percent)
# ---------- code_block_2.designscript (8 lines) ----------
Count(ct)*List.GetItemAtIndex(lst,0);
Count(ct)*List.GetItemAtIndex(lst,1);
Count(ct)*List.GetItemAtIndex(lst,2);
Count(ct)*List.GetItemAtIndex(lst,3);
Count(ct)*List.GetItemAtIndex(lst,4);
Count(ct)*List.GetItemAtIndex(lst,5);
Count(ct)*List.GetItemAtIndex(lst,6);
Count(ct)*List.GetItemAtIndex(lst,7);
# ----------------------------------------
create = List.Create(code_block_2.out0, code_block_2.out1, code_block_2.out2, code_block_2.out3, code_block_2.out4, code_block_2.out5, code_block_2.out6, code_block_2.out7)
clean = List.Clean(list=create)
round = Math.Round(clean)
code_block_3 = CodeBlock(ct=points, lst=round) { Count(ct)-Math.Sum(lst); }
code_block_4 = CodeBlock { 0; }
eq = code_block_3 == code_block_4
addItemToEnd = List.AddItemToEnd(code_block_3, round)
code_block_5 = CodeBlock(test=eq, iftrue=round, iffalse=addItemToEnd) { i(test,iftrue,iffalse); }
combine = List.Combine(cycle, chop, code_block_5)
flatten = Flatten(combine)
combine_2 = List.Combine(byPoint, flatten, points)
FamilyInstance = Output(combine_2)
code_block_6 = CodeBlock()
# ---------- code_block_6.designscript (15 lines) ----------
def i(test,iftrue:var[]..[],
iffalse:var[]..[])
{
return = [Imperative]
{
if (test)
{
return = iftrue;
}
else
{
return = iffalse;
}
}
};
# ----------------------------------------
