# Dynamo custom node FamilyInstance.RandomRotation.dyf (Dynamo 0.9.0.3067)
# category: Landform.Revit.Elements.FamilyInstance
# Rotates the angle of the family instance a random amount (between 0 and 360).

familyInstance = Input()
code_block = CodeBlock { 0; }
code_block_2 = CodeBlock { 360; }
count = Count(familyInstance)
randomIntegerMin = Custom[Math.RandomIntegerMin](min=code_block, max=code_block_2, amount=count)  # Creates a list of random integers between a given minimum and maximum value
setRotation = FamilyInstance.SetRotation(familyInstance=familyInstance, degree=randomIntegerMin)
FamilyInstance = Output(setRotation)
