# Dynamo custom node IndexOf.Equals.dyf (Dynamo 0.9.2.4472)
# category: Landform.Core.List
# Returns the indices of items in list B that are equal to items in list A.

listA = Input()
listB = Input()
create_list = List.Create(listA, listB)
python_script = Python(IN[0]=create_list)
# ---------- python_script.python (10 lines) ----------
listaA = IN[0][0]
listaB = IN[0][1]
indiceslist = list()
for lA in listaA:
	counter = 0
	for lB in listaB:
		if (lA == lB):
			indiceslist.append(counter)
		counter += 1
OUT = indiceslist
# ----------------------------------------
Index = Output(python_script)
