# Dynamo custom node NurbsSurface.ByNurbsCurves.dyf (Dynamo 1.1.0.2094)
# category: Landform.Geometry.NurbsSurface
# Creates a NurbsSurface with points generated from an interval along the specified curves.

addItemToEnd = List.AddItemToEnd()
curves = Input()
python_script = Python(IN[0]=curves)
# ---------- python_script.python (20 lines) ----------
import clr
clr.AddReference('ProtoGeometry')
from Autodesk.DesignScript.Geometry import *
#The inputs to this node will be stored as a list in the IN variable.
dataEnteringNode = IN

def ClearList(_list):
    out = []
    for _list1 in _list:
        if _list1 is None:
            continue
        if isinstance(_list1, list):
             _list1 = ClearList(_list1)
             if not _list1:
                 continue
        out.append(_list1)
    return out

#Assign your output to the OUT variable
OUT = ClearList(IN[0])
# ----------------------------------------
endPoint = Curve.EndPoint(python_script)
create = List.Create()
map = List.Map(list=endPoint, f_x=create)
code_block = CodeBlock(data=python_script) { data; }
length = Curve.Length(python_script)
maximumItem = List.MaximumItem(length)
interval = Input(interval : double)
code_block_2 = CodeBlock(x=maximumItem, y=interval) { x/y; }
round = Math.Round(code_block_2)
code_block_3 = CodeBlock(data=round) { data; }
pointsAtEqualSegmentLength = Curve.PointsAtEqualSegmentLength(divisions=code_block_3)
splitByPoints = Curve.SplitByPoints(curve=code_block, points=pointsAtEqualSegmentLength)
startPoint = Curve.StartPoint(splitByPoints)
combine = List.Combine(addItemToEnd, map, startPoint)
code_block_4 = CodeBlock(lst=combine) { Flatten(lst<1>); }
byPoints = NurbsSurface.ByPoints(code_block_4)
NurbsSurface = Output(byPoints)
flatten = Flatten(code_block_4)
points = Output(flatten)
