# Dynamo custom node Point.GridTriangleContain.dyf (Dynamo 0.9.0.3067)
# category: Landform.Geometry.Point
# Create a triangular grid of points contained within a set of boundary curves.

curves = Input()
spacing = Input()
gridTriangle = Custom[Point.GridTriangle](curve=curves, spacing=spacing)  # Create a triangular grid of points over an area from a set of boundary curves.
containmentTest = Polygon.ContainmentTest()
byPoints = Polygon.ByPoints(gridTriangle.BoundPoints)
combine = List.Combine(containmentTest, byPoints, gridTriangle.GridPoints)
filterByBoolMask = List.FilterByBoolMask(list=gridTriangle.GridPoints, mask=combine)
Points = Output(filterByBoolMask.in)
