# Dynamo custom node Point.Random.dyf (Dynamo 0.9.0.3067)
# category: Landform.Geometry.Point
# Creates a random set of points within a set of boundary cuves. Tolerance specifies the minimum distance between points.

curves = Input()
flatten = Flatten(curves)
byJoinedCurves = PolyCurve.ByJoinedCurves(flatten)
patch = Curve.Patch(byJoinedCurves)
amount = Input(amount : int)
randomList = Math.RandomList(amount)
randomList_2 = Math.RandomList(amount)
pointAtParameter = Surface.PointAtParameter(surface=patch, u=randomList, v=randomList_2)
tolerance = Input(tolerance : double)
pruneDuplicates = Point.PruneDuplicates(points=pointAtParameter, tolerance=tolerance)
perimeterCurves = Surface.PerimeterCurves(patch)
startPoint = Curve.StartPoint(perimeterCurves)
byPoints = Polygon.ByPoints(startPoint)
containmentTest = Polygon.ContainmentTest(byPoints, pruneDuplicates)
filterByBoolMask = List.FilterByBoolMask(list=pruneDuplicates, mask=containmentTest)
Points = Output(filterByBoolMask.in)
