# Dynamo custom node Point.ShiftCoordinates.dyf (Dynamo 0.9.0.3067)
# category: Landform.Geometry.Point
# Shifts the coordinates of the point by the given amount. The default shift is positive (add) but can be switched to negative (via boolean).

point = Input()
X = Point.X(point)
shift = Input()
add = Input(add : bool = true)
code_block = CodeBlock { 1; }
code_block_2 = CodeBlock { -1; }
if_ = If(test=add, true=code_block, false=code_block_2)
Y = Point.Y(point)
Z = Point.Z(point)
code_block_3 = CodeBlock(x=X, bp=shift, t=if_, y=Y, z=Z) { x+bp[0]*t; y+bp[1]*t; z+bp[2]*t; }
byCoordinates = Point.ByCoordinates(x=code_block_3.out0, y=code_block_3.out1, z=code_block_3.out2)
Point = Output(byCoordinates)
