# Dynamo custom node Point.XRange.dyf (Dynamo 0.9.0.3067)
# category: Landform.Geometry.Point
# Get all X components and the minimum and maximum X components from a list of Points.

points = Input()
X = Point.X(points)
double = Output(X)
minimumItem = List.MinimumItem(X)
min = Output(minimumItem)
maximumItem = List.MaximumItem(X)
max = Output(maximumItem)
