# Dynamo custom node Point.XYZ.dyf (Dynamo 0.9.0.3067)
# category: Landform.Geometry.Point
# Get the X, Y, and Z components of a Point

point = Input()
X = Point.X(point)
X_2 = Output(X)  # "X"
Y = Point.Y(point)
Y_2 = Output(Y)  # "Y"
Z = Point.Z(point)
Z_2 = Output(Z)  # "Z"
