# Dynamo custom node Point.XYZByCoordinates.dyf (Dynamo 0.9.0.3067)
# category: Landform.Geometry.Point
# Get the X,Y, and Z components and create a point from those coordinates.

pointX = Input()
X = Point.X(pointX)
pointY = Input()
Y = Point.Y(pointY)
pointZ = Input()
Z = Point.Z(pointZ)
byCoordinates = Point.ByCoordinates(x=X, y=Y, z=Z)
Point = Output(byCoordinates)
