# Dynamo custom node Point.YRange.dyf (Dynamo 0.9.0.3067)
# category: Landform.Geometry.Point
# Get all Y components and the minimum and maximum Y components from a list of Points.

points = Input()
Y = Point.Y(points)
double = Output(Y)
minimumItem = List.MinimumItem(Y)
min = Output(minimumItem)
maximumItem = List.MaximumItem(Y)
max = Output(maximumItem)
