# Dynamo custom node Point.ZRange.dyf (Dynamo 0.9.0.3067)
# category: Landform.Geometry.Point
# Get all Z components and the minimum and maximum Z components from a list of Points.

points = Input()
Z = Point.Z(points)
double = Output(Z)
minimumItem = List.MinimumItem(Z)
min = Output(minimumItem)
maximumItem = List.MaximumItem(Z)
max = Output(maximumItem)
