# Dynamo custom node Points.SameXY.dyf (Dynamo 2.6.1.8786)
# category: Landform.Geometry.Point
# Find points that share the same XY (or overlap in plan). Used for creating Topography.
# packages: Landform 2016.10.13

points = Input(points: var[]..[])
sortByXY = Custom[Points.SortByXY](points=points)  # package Landform; Sort list of points based on its X and Y coordinate values. In order to sort correctly, points must be rounded (default value is 3 decimal points).
Y = Point.Y(point=sortByXY.XthenY)
code_block = CodeBlock { -1; }
shiftIndices = List.ShiftIndices(list=Y, amount=code_block)
eq = Y == shiftIndices
countTrue = List.CountTrue(list=eq)
code_block_2 = CodeBlock { 1; }
shiftIndices_2 = List.ShiftIndices(list=Y, amount=code_block_2)
eq_2 = Y == shiftIndices_2
countTrue_2 = List.CountTrue(list=eq_2)
add = countTrue + countTrue_2
count = Output(add)
filterByBoolMask = List.FilterByBoolMask(list=sortByXY.XthenY, mask=eq)
filterByBoolMask_2 = List.FilterByBoolMask(list=sortByXY.XthenY, mask=eq_2)
join = List.Join(list0=filterByBoolMask.in, list1=filterByBoolMask_2.in)
points_2 = Output(join)  # "points"
