# Dynamo custom node Points.SortByDistance.dyf (Dynamo 0.9.0.3067)
# category: Landform.Core.List
# Sort a list of points based on their distance from a specified point

points = Input()
basePoint = Input()
matchLength = Custom[List.MatchLength](listLength=points, list=basePoint)  # Cycle a list to match the length of the first list.
byStartPointEndPoint = Line.ByStartPointEndPoint(startPoint=matchLength, endPoint=points)
length = Curve.Length(byStartPointEndPoint)
sortByKey = Custom[List.SortByKey](list=points, keys=length)  # Sort a list (or lists) according to the order specified by the key list.
sorted_list = Output(sortByKey.sorted_list)
