# Dynamo custom node Points.SortByXY.dyf (Dynamo 0.9.0.3067)
# category: Landform.Core.List
# Sort list of points based on its X and Y coordinate values. In order to sort correctly, points must be rounded (default value is 3 decimal points).

points = Input()
Y = Point.Y(points)
round = Input(round : int = 3)
round_2 = Math.Round(number=Y, digits=round)
sortByKey = SortByKey(points, round_2)
X = Point.X(sortByKey)
round_3 = Math.Round(number=X, digits=round)
sortByKey_2 = SortByKey(sortByKey, round_3)
XthenY = Output(sortByKey_2)
X_2 = Point.X(points)
round_4 = Math.Round(number=X_2, digits=round)
sortByKey_3 = SortByKey(points, round_4)
Y_2 = Point.Y(sortByKey_3)
round_5 = Math.Round(number=Y_2, digits=round)
sortByKey_4 = SortByKey(sortByKey_3, round_5)
YthenX = Output(sortByKey_4)
