# Dynamo custom node PointsToCSV.dyf (Dynamo 0.9.0.3067)
# category: Landform.Core.File.CSV
# Write a list of points into a file using a comma-separated values format.

filePath = Input()
points = Input()
flatten = Flatten(points)
X = Point.X(flatten)
Y = Point.Y(flatten)
Z = Point.Z(flatten)
create = List.Create(X, Y, Z)
round = Input(round : int = 3)
round_2 = Math.Round(number=create, digits=round)
transpose = List.Transpose(round_2)
writeToFile = CSV.WriteToFile(filePath, transpose)
str = Output(writeToFile)
