# Dynamo custom node SlabShape.AddAdjacentPoints.dyf (Dynamo 1.1.0.2094)
# category: Landform.Revit.Elements.Floor
# Add and match adjacent slab shape points (Floor or Roof) from Slab 1 to Slab 2. (requires Spring Nodes and Clockwork packages)

Slab2 = Input()
code_block = CodeBlock(data=Slab2) { data; }
points = Custom[SlabShape.Points](FloorOrRoof=code_block)  # Get the XYZ points of any slab shape Roof or Floor.
elementSketch = Custom[Springs.Collector.ElementSketch](element=code_block)  # Get the actual sketch lines of a sketch based element (floor, ceiling, modified wall, etc.) . You can optionally fetch the matching model curves, however this might prove comptationally heavy on larger data sets.
flatten = Flatten(elementSketch.curves)
byJoinedCurves = PolyCurve.ByJoinedCurves(flatten)
ZAxis = Vector.ZAxis()
Slab1 = Input()
code_block_2 = CodeBlock(data=Slab1) { data; }
points_2 = Custom[SlabShape.Points](FloorOrRoof=code_block_2, lacing=CrossProduct)
flatten_2 = Flatten(points_2)
ZRange = Custom[Point.ZRange](points=flatten_2)  # Get all Z components and the minimum and maximum Z components from a list of Points.
code_block_3 = CodeBlock(z=ZRange.max) { z+1; }
firstItem = List.FirstItem(flatten)
startPoint = Curve.StartPoint(firstItem)
Z = Point.Z(startPoint)
code_block_4 = CodeBlock(z1=code_block_3, z2=Z) { z1-z2; }
extrude = Curve.Extrude(curve=byJoinedCurves, direction=ZAxis, distance=code_block_4)
intersectAll = Geometry.IntersectAll(geometry=extrude, others=flatten_2, lacing=CrossProduct)
flatten_3 = Flatten(intersectAll)
join = List.Join(points, flatten_3)
wait = Custom[Springs.Input.Wait](WaitForMe=join, Output=join)  # Waits for all inputs to be completed before continuing the execution process.Part of the SmartCopyMon workflow.
slabShapeByPoints = Custom[Floor.SlabShapeByPoints](points=wait, floor=code_block)  # Transform a slab shape based on a list of XYZs. PLEASE NOTE: Will reset any previous edits on the slab shape.
floor = Output(slabShapeByPoints)
