# Dynamo custom node Topography.ByLines.dyf (Dynamo 1.1.0.2094)
# category: Landform.Revit.Elements.Topography
# Create a toposurface from lines. Generates points at a specified interval along the lines.

lines = Input()
geometry = Element.Geometry(lines)
flatten = Flatten(geometry)
startPoint = Curve.StartPoint(flatten)
length = Curve.Length(flatten)
interval = Input()
code_block = CodeBlock(len=length, i=interval) { len/i; }
round = Math.Round(code_block)
pointsAtEqualSegmentLength = Curve.PointsAtEqualSegmentLength(curve=flatten, divisions=round)
endPoint = Curve.EndPoint(flatten)
create = List.Create(startPoint, pointsAtEqualSegmentLength, endPoint)
flatten_2 = Flatten(create)
pruneDuplicates = Point.PruneDuplicates(points=flatten_2)
byPoints = Topography.ByPoints(pruneDuplicates)
Topography = Output(byPoints)
