# Dynamo custom node Topography.ColorByElevation.dyf (Dynamo 0.9.0.3067)
# category: Landform.Revit.Analysis
# Applies a color range based on the elevation of each triangle face. Elevation is calculated from the center point of each triangle face.

topography = Input(topography : Revit.Topography)
mesh = Topography.Mesh(topography)
code_block = CodeBlock(m=mesh)
# ---------- code_block.designscript (6 lines) ----------
vp = m.VertexPositions;
fi = m.FaceIndices;
a = List.GetItemAtIndex(vp,fi.A);
b = List.GetItemAtIndex(vp,fi.B);
c = List.GetItemAtIndex(vp,fi.C);
List.Transpose({a,b,c});
# ----------------------------------------
byPerimeterPoints = Surface.ByPerimeterPoints(code_block.out5)
Surface = Output(byPerimeterPoints)
colors = Input()
code_block_2 = CodeBlock { 0.5; }
pointAtParameter = Surface.PointAtParameter(surface=byPerimeterPoints, u=code_block_2, v=code_block_2)
ZRange = Custom[Point.ZRange](points=pointAtParameter)  # Get all Z components and the minimum and maximum Z components from a list of Points.
code_block_3 = CodeBlock { 3; }
round = Math.Round(number=ZRange.min, digits=code_block_3)
code_block_4 = CodeBlock(p=ZRange.double, min=round) { p-min; Math.Round(List.MaximumItem(p-min),3); }
code_block_5 = CodeBlock(lst=colors) { Count(lst)-1; }
code_block_6 = CodeBlock(max=code_block_4.out1, ct=code_block_5) { (0..max..max/ct)/max; }
code_block_7 = CodeBlock(pt=code_block_4.out0, max=code_block_4.out1) { pt/max; }
color_range = ColorRange(colors, code_block_6, code_block_7)
color = Output(color_range)
byGeometryColor = Display.Display.ByGeometryColor(byPerimeterPoints, color_range)
Display = Output(byGeometryColor)
