# Dynamo custom node Topography.ColorBySlope.dyf (Dynamo 0.9.0.3067)
# category: Landform.Revit.Analysis
# Applies a color range based on the slope of the triangle faces. Based on percentage slope. Max slope index is 1 (100%, or 45 degrees).

topography = Input(topography : Revit.Topography)
mesh = Topography.Mesh(topography)
faceVertices = CodeBlock(m=mesh)  # "Mesh.FaceVertices"
# ---------- faceVertices.designscript (6 lines) ----------
vp = m.VertexPositions;
fi = m.FaceIndices;
a = List.GetItemAtIndex(vp,fi.A);
b = List.GetItemAtIndex(vp,fi.B);
c = List.GetItemAtIndex(vp,fi.C);
List.Transpose({a,b,c});
# ----------------------------------------
byPerimeterPoints = Surface.ByPerimeterPoints(faceVertices.out5)
Surface = Output(byPerimeterPoints)
colors = Input()
indices = Input()
code_block = CodeBlock { 0.5; }
pointAtParameter = Surface.PointAtParameter(surface=byPerimeterPoints, u=code_block, v=code_block)
normalAtPoint = Surface.NormalAtPoint(surface=byPerimeterPoints, point=pointAtParameter)
ZAxis = Vector.ZAxis()
angleBetween = Vector.AngleBetween(normalAtPoint, ZAxis)
formula = Formula("tan(x*0.0174533)", x=angleBetween)
color_range = ColorRange(colors, indices, formula)
color = Output(color_range)
byGeometryColor = Display.Display.ByGeometryColor(byPerimeterPoints, color_range)
Display = Output(byGeometryColor)
