# Dynamo custom node Topography.Plane.XZ.dyf (Dynamo 0.9.0.3067)
# category: Landform.Geometry.Plane
# Creates a row of planes cutting through the Toposurface in the world XZ

topography = Input(topography : Revit.Topography)
points = Topography.Points(topography)
XRange = Custom[Point.XRange](points=points)  # Get all X components and the minimum and maximum X components from a list of Points.
YRange = Custom[Point.YRange](points=points)  # Get all Y components and the minimum and maximum Y components from a list of Points.
offset = Input(offset : double)
code_block = CodeBlock(start=YRange.min, end=YRange.max, interval=offset) { (start..end..interval); }
count = List.Count(code_block)
cycle = List.Cycle(list=XRange.min, amount=count)
byCoordinates = Point.ByCoordinates(x=cycle, y=code_block)
count_2 = List.Count(code_block)
cycle_2 = List.Cycle(list=XRange.max, amount=count_2)
byCoordinates_2 = Point.ByCoordinates(x=cycle_2, y=code_block)
byStartPointEndPoint = Line.ByStartPointEndPoint(startPoint=byCoordinates, endPoint=byCoordinates_2)
code_block_2 = CodeBlock { 10; }
byCoordinates_3 = Point.ByCoordinates(x=cycle_2, y=code_block, z=code_block_2)
byLineAndPoint = Plane.ByLineAndPoint(byStartPointEndPoint, byCoordinates_3)
planes = Output(byLineAndPoint)
topo = Output(topography)
